# Dynamo graph covid.dyn (Dynamo 2.12.0.5650)

byCoordinates = Point.ByCoordinates()
code_block = CodeBlock { 100; }
byCenterPointRadius = Sphere.ByCenterPointRadius(centerPoint=byCoordinates, radius=code_block)
explode = Geometry.Explode(geometry=byCenterPointRadius)
code_block_2 = CodeBlock(i=explode) { i[0]; }
code_block_3 = CodeBlock { 0..1..0.1; }
pointAtParameter = Surface.PointAtParameter(surface=code_block_2, u=code_block_3, v=code_block_3, lacing=CrossProduct)
byTwoPoints = Vector.ByTwoPoints(start=byCoordinates, end=pointAtParameter)
code_block_4 = CodeBlock { 0.01*20; }
scale = Vector.Scale(vector=byTwoPoints, scale_factor=code_block_4)
translate = Geometry.Translate(geometry=pointAtParameter, direction=scale)
code_block_5 = CodeBlock { 5; 3; }
byPointsRadii = Cone.ByPointsRadii(startPoint=pointAtParameter, endPoint=translate, startRadius=code_block_5.out0, endRadius=code_block_5.out1)
code_block_6 = CodeBlock { 0.01*5; }
scale_2 = Vector.Scale(vector=byTwoPoints, scale_factor=code_block_6)
translate_2 = Geometry.Translate(geometry=translate, direction=scale_2)
code_block_7 = CodeBlock { 10; 10; }
byPointsRadii_2 = Cone.ByPointsRadii(startPoint=translate, endPoint=translate_2, startRadius=code_block_7.out0, endRadius=code_block_7.out1)
